# Grasshopper definition rfem6-beam-example.gh (Grasshopper 1.0.8)
# plug-ins: GrasshopperRfem6WsPlugin

number_slider = Slider(2, range=0..10)
expression = Expression(x=number_slider, y=Slider(4, range=0..10), Expression="x+y")
pt = ConstructPoint(XCoordinate=0, YCoordinate=0, ZCoordinate=0)
pt_2 = ConstructPoint(XCoordinate=number_slider, YCoordinate=0, ZCoordinate=0)
pt_3 = ConstructPoint(XCoordinate=expression, YCoordinate=0, ZCoordinate=0)
ln = Line(StartPoint=pt, EndPoint=pt_2)
ln_2 = Line(StartPoint=pt_2, EndPoint=pt_3)
material = Material(MaterialNo="1", MaterialName="S235", mode="Assemble")
relay = Relay([ln_2, ln])
relay_2 = Relay([pt_2, pt_3])
cross_section = CrossSection(SectionNo="1", SectionName="IPE 300", MaterialNo=material, mode="Assemble")
list = ValueList({"TYPE_ANCHOR": 0, "TYPE_BEAM": 1, "TYPE_BUCKLING": 2, "TYPE_CABLE": 3, "TYPE_CABLE_ON_PULLEYS": 4, "TYPE_COMPRESSION": 5, "TYPE_COUPLING_HINGE_HINGE": 6, "TYPE_COUPLING_HINGE_RIGID": 7, "TYPE_COUPLING_RIGID_HINGE": 8, "TYPE_COUPLING_RIGID_RIGID": 9, "TYPE_DAMPER": 10, "TYPE_DEEP_BEAM": 11, "TYPE_DEFINABLE_STIFFNESS": 12, "TYPE_DESIGN_STRIP": 13, "TYPE_JOIST": 14, "TYPE_LOAD_TRANSFER": 15, "TYPE_PILE": 16, "TYPE_RESULT_BEAM": 17, "TYPE_RESULT_LINE": 18, "TYPE_RIB": 19, "TYPE_RIGID": 20, "TYPE_SHEAR_WALL": 21, "TYPE_SPRING": 22, "TYPE_SURFACE_MODEL": 23, "TYPE_TENDON_CABLE": 24, "TYPE_TENDON_REBAR": 25, "TYPE_TENSION": 26, "TYPE_TRUSS": 27, "TYPE_TRUSS_ONLY_N": 28}, selected="TYPE_BEAM")
nodal_support = NodalSupport(
    GHNode=pt,
    TranslationalSpringX="inf",
    TranslationalSpringY="inf",
    TranslationalSpringZ="inf",
    RotationalRestraintX="inf",
    RotationalRestraintZ="inf",
    mode="Assemble")
nodal_support_2 = NodalSupport(
    GHNode=relay_2,
    TranslationalSpringY="inf",
    TranslationalSpringZ="inf",
    RotationalRestraintX="inf",
    RotationalRestraintZ="inf",
    mode="Assemble")
member = Member(GHLine=relay, SectionStart=cross_section, MemberType=list, mode="Assemble")
merge = Merge(Data1=material, Data2=cross_section, Data3=member, Data4=nodal_support, Data5=nodal_support_2)

# ----
# ULS COMBO
panel = Panel("1")
panel_2 = Panel("""1
2""")

# ----
# SLS COMBO
panel_3 = Panel("1")
panel_4 = Panel("""1
2""")

# ----
# ULS COMBO
# FACTORS
panel_5 = Panel("1.35")
panel_6 = Panel("""1.35
1.5""")

# ----
# SLS COMBO
# FACTORS
panel_7 = Panel("1")
panel_8 = Panel("""1
1""")

load_case_classification_component = LoadCaseClassificationComponent(ActionIndex=0, DesignIndex=3, StandardIndex=0, menu=[dropdown(0), dropdown(0), dropdown(3)])  # -> ActionCategory, DesignSituationType
design_situation = DesignSituation(
    ObjectNumber="2",
    DesignSituationName="SLS",
    DesignSituationType=load_case_classification_component.DesignSituationType,
    mode="Assemble")
panel_9 = Panel("Serviceability Limit State")

entwine = Entwine(Branch00=panel, Branch01=panel_2, Branch02=panel_3, Branch03=panel_4, FlattenInputs=True)
entwine_2 = Entwine(Branch00=panel_5, Branch01=panel_6, Branch02=panel_7, Branch03=panel_8, FlattenInputs=True)
panel_10 = Panel(entwine)
panel_11 = Panel(entwine_2)
load_combination_items = LoadCombinationItems(LoadCaseNo=entwine, Factor=entwine_2, mode="Assemble")
panel_12 = Panel("""CO1 ULS
CO2 ULS
CO1 SLS
CO2 SLS""")
panel_13 = Panel("""1
1
2
2""")
load_combination = LoadCombination(
    LoadCombinationName=graft(panel_12),
    Items=load_combination_items,
    StaticAnalysisSettingsNo="1",
    DesignSituationNo=graft(panel_13),
    mode="Assemble")

load_case_classification_component_2 = LoadCaseClassificationComponent(ActionIndex=0, DesignIndex=13, StandardIndex=0, menu=[dropdown(0), dropdown(0), dropdown(13)])  # -> ActionCategory, DesignSituationType
load_case = LoadCase(
    LoadCaseNo="1",
    LoadCaseName="Self-weight",
    StaticAnalysisSettings="1",
    ActionCategory=load_case_classification_component_2.ActionCategory,
    SelfWeightActive=Toggle(True),
    ToSolve=Toggle(True),
    mode="Assemble")

load_case_classification_component_3 = LoadCaseClassificationComponent(ActionIndex=4, DesignIndex=0, StandardIndex=0, menu=[dropdown(0), dropdown(4), dropdown(0)])  # -> ActionCategory, DesignSituationType
load_case_2 = LoadCase(
    LoadCaseNo="2",
    LoadCaseName="Imposed Load",
    StaticAnalysisSettings="1",
    ActionCategory=load_case_classification_component_3.ActionCategory,
    ToSolve=Toggle(True),
    mode="Assemble")

list_2 = ValueList({"GEOMETRICALLY_LINEAR": 0, "LARGE_DEFORMATIONS": 1, "SECOND_ORDER_P_DELTA": 2}, selected="GEOMETRICALLY_LINEAR")
static_analysis_settings = StaticAnalysisSettings(StaticAnalysisSettingNo="1", AnalysisType=list_2, ExceptionalHandling=Toggle(False), mode="Assemble")

design_situation_2 = DesignSituation(
    ObjectNumber="1",
    DesignSituationName="ULS",
    DesignSituationType="DESIGN_SITUATION_TYPE_EQU_PERMANENT_AND_TRANSIENT",
    mode="Assemble")
panel_14 = Panel("Ultimate Limit State")

list_3 = ValueList({"LOAD_DIRECTION_GLOBAL_X_OR_USER_DEFINED_U_PROJECTED": 0, "LOAD_DIRECTION_GLOBAL_X_OR_USER_DEFINED_U_TRUE": 1, "LOAD_DIRECTION_GLOBAL_Y_OR_USER_DEFINED_V_PROJECTED": 2, "LOAD_DIRECTION_GLOBAL_Y_OR_USER_DEFINED_V_TRUE": 3, "LOAD_DIRECTION_GLOBAL_Z_OR_USER_DEFINED_W_PROJECTED": 4, "LOAD_DIRECTION_GLOBAL_Z_OR_USER_DEFINED_W_TRUE": 5, "LOAD_DIRECTION_LOCAL_X": 6, "LOAD_DIRECTION_LOCAL_Y": 7, "LOAD_DIRECTION_LOCAL_Z": 8, "LOAD_DIRECTION_PRINCIPAL_U": 9, "LOAD_DIRECTION_PRINCIPAL_V": 10}, selected="LOAD_DIRECTION_GLOBAL_Z_OR_USER_DEFINED_W_TRUE")
list_4 = ValueList({"LOAD_DISTRIBUTION_CONCENTRATED_1": 0, "LOAD_DISTRIBUTION_CONCENTRATED_2": 1, "LOAD_DISTRIBUTION_CONCENTRATED_2x2": 2, "LOAD_DISTRIBUTION_CONCENTRATED_N": 3, "LOAD_DISTRIBUTION_CONCENTRATED_VARYING": 4, "LOAD_DISTRIBUTION_PARABOLIC": 5, "LOAD_DISTRIBUTION_TAPERED": 6, "LOAD_DISTRIBUTION_TRAPEZOIDAL": 7, "LOAD_DISTRIBUTION_UNIFORM": 8, "LOAD_DISTRIBUTION_UNIFORM_TOTAL": 9, "LOAD_DISTRIBUTION_VARYING": 10, "LOAD_DISTRIBUTION_VARYING_IN_Z": 11}, selected="LOAD_DISTRIBUTION_UNIFORM")
list_5 = ValueList({"E_TYPE_MASS": 0, "LOAD_TYPE_AXIAL_DISPLACEMENT": 1, "LOAD_TYPE_AXIAL_STRAIN": 2, "LOAD_TYPE_COATING_CONTOUR": 3, "LOAD_TYPE_COATING_POLYGON": 4, "LOAD_TYPE_DISPLACEMENT": 5, "LOAD_TYPE_END_PRESTRESS": 6, "LOAD_TYPE_FORCE": 7, "LOAD_TYPE_FORM_FINDING": 8, "LOAD_TYPE_INITIAL_PRESTRESS": 9, "LOAD_TYPE_MOMENT": 10, "LOAD_TYPE_PIPE_CONTENT_FULL": 11, "LOAD_TYPE_PIPE_CONTENT_PARTIAL": 12, "LOAD_TYPE_PIPE_INTERNAL_PRESSURE": 13, "LOAD_TYPE_PRECAMBER": 14, "LOAD_TYPE_PRESTRESS_TENDON": 15, "LOAD_TYPE_ROTARY_MOTION": 16, "LOAD_TYPE_ROTATION": 17, "LOAD_TYPE_TEMPERATURE": 18, "LOAD_TYPE_TEMPERATURE_CHANGE": 19}, selected="LOAD_TYPE_FORCE")
panel_15 = Panel("""1
2""")
neg = Negative(Value=Slider(5000, range=0..10000))
member_load = MemberLoad(
    LoadCaseNo="2",
    MembersNo=panel_15,
    LoadType=list_5,
    LoadDistribution=list_4,
    LoadDirection=list_3,
    LoadMagnitudeP=neg,
    mode="Assemble")

merge_2 = Merge(Data1=static_analysis_settings, Data2=load_case, Data3=load_case_2)

dlubal_login = DlubalLogin()
list_6 = ValueList({"None": 0, "Microns": 1, "Millimeters": 2, "Centimeters": 3, "Meters": 4, "Kilometers": 5, "Microinches": 6, "Mils": 7, "Inches": 8, "Feet": 9, "Miles": 10, "CustomUnits": 11, "Angstroms": 12, "Nanometers": 13, "Decimeters": 14, "Dekameters": 15, "Hectometers": 16, "Megameters": 17, "Gigameters": 18, "Yards": 19, "PrinterPoints": 20, "PrinterPicas": 21, "NauticalMiles": 22, "AstronomicalUnits": 23, "LightYears": 24, "Parsecs": 25, "Unset": 26}, selected="Meters")
rfem_export = RFEM6ExportComponent(
    Run=Toggle(False),
    Input=flatten([merge, merge_2, design_situation, design_situation_2, load_combination, member_load]),
    Units=list_6,
    Overwrite=Toggle(True),
    ReadLog=dlubal_login)  # -> RFEMData, Log, SuccessfulExport
